# Grasshopper definition ToGh.gh (Grasshopper 1.0.8)
# plug-ins: Karamba3D, RhinoCodePluginGH, LunchBox, Ivy, Weaverbird, ShapeDiverForGrasshopper, Kangaroo2 Components

sddp = ShapeDiverDocumentPayload({AbsoluteTolerance=0, AngleTolerance=0, DistanceDisplayPrecision=0, GltfVersion="Gltf2", GrasshopperVersion="1.0.0008", InputGroups="{}", OutputGroups="{}", RelativeTolerance=0, RhinoVersion="8.12.24282.7001", UnitSystem=0, VersionCreated="1.24.1.0", VersionSaved="1.25.0.0"})
path = FilePath("C:\old laptop phd\PhD\Digital Geometry & Modeling\demo b submission\final_version\output.csv")
path_2 = FilePath("C:\old laptop phd\PhD\Digital Geometry & Modeling\demo b submission\final_version\output\mesh.obj")
py3 = Python3Script(path=path_2)  # -> out, mesh_out
# ---------- py3: Python ----------
import Rhino
import rhinoscriptsyntax as rs
import scriptcontext as sc
import System
import os

# Input: path (string) — full path to the .obj file
# Output: mesh_out (Mesh) — the imported mesh

# Ensure input path is valid
if os.path.exists(path) and path.lower().endswith(".obj"):
    # Clear previous selection to avoid importing into active doc
    sc.doc = Rhino.RhinoDoc.ActiveDoc

    # Import the .obj file
    success = Rhino.RhinoApp.RunScript('_-Import "{}" _Enter'.format(path), False)

    if success:
        # Get the last created object (assuming it's the imported mesh)
        objs = sc.doc.Objects
        mesh_objs = [obj for obj in objs if isinstance(obj.Geometry, Rhino.Geometry.Mesh)]

        if mesh_objs:
            mesh_out = mesh_objs[-1].Geometry
        else:
            mesh_out = None
            print("No mesh found in the imported file.")
    else:
        mesh_out = None
        print("Failed to import OBJ file.")
else:
    mesh_out = None
    print("Invalid path or file is not an OBJ.")









mesh = mesh_out
# import Rhino
# import Grasshopper
# from Grasshopper import DataTree
# from Grasshopper.Kernel.Data import GH_Path
# from collections import defaultdict, deque

# # === Parameters ===
# tolerance = 15  # Color similarity tolerance for grouping
# min_cluster_size = 2  # Minimum cluster size to avoid treating as boundary/outlier

# # === Helper functions ===
# def rounded_color(c, tol):
#     return (c.R // tol, c.G // tol, c.B // tol)

# def get_face_avg_color(mesh, face_idx):
#     face = mesh.Faces[face_idx]
#     vi = [face.A, face.B, face.C] if face.IsTriangle else [face.A, face.B, face.C, face.D]
#     colors = [mesh.VertexColors[j] for j in vi]
#     avg_r = sum(c.R for c in colors) // len(colors)
#     avg_g = sum(c.G for c in colors) // len(colors)
#     avg_b = sum(c.B for c in colors) // len(colors)
#     return (avg_r, avg_g, avg_b)

# def color_distance(c1, c2):
#     return sum(abs(a - b) for a, b in zip(c1, c2))

# # === Step 1: Group by approximate color ===
# clusters = defaultdict(list)
# face_colors = []
# for i in range(mesh.Faces.Count):
#     avg_col = get_face_avg_color(mesh, i)
#     rounded = tuple(c // tolerance for c in avg_col)
#     clusters[rounded].append(i)
#     face_colors.append(avg_col)

# # === Step 2: Build face adjacency map ===
# adjacency = defaultdict(set)
# for i in range(mesh.Faces.Count):
#     neighbors = mesh.Faces.AdjacentFaces(i)
#     for n in neighbors:
#         adjacency[i].add(n)

# # === Step 3: Reassign small clusters / boundary faces ===
# # Flatten all clusters
# flat_clusters = {}
# cluster_index = 0
# for color_bin, faces in clusters.items():
#     for f in faces:
#         flat_clusters[f] = cluster_index
#     cluster_index += 1

# # Reassign faces in tiny clusters to neighbors
# cluster_counts = defaultdict(int)
# for c in flat_clusters.values():
#     cluster_counts[c] += 1

# for f, current_cluster in flat_clusters.items():
#     if cluster_counts[current_cluster] >= min_cluster_size:
#         continue  # Big enough, skip

#     neighbors = adjacency[f]
#     best_match = None
#     best_dist = float('inf')
    
#     for n in neighbors:
#         neighbor_cluster = flat_clusters.get(n, None)
#         if neighbor_cluster is None:
#             continue
#         dist = color_distance(face_colors[f], face_colors[n])
#         if dist < best_dist:
#             best_dist = dist
#             best_match = neighbor_cluster

#     if best_match is not None and best_match != current_cluster:
#         flat_clusters[f] = best_match

# # === Step 4: Rebuild final clusters and output as DataTree ===
# final = defaultdict(list)
# for f, cid in flat_clusters.items():
#     final[cid].append(f)

# face_clusters = DataTree[int]()
# for i, (cid, faces) in enumerate(final.items()):
#     path = GH_Path(i)
#     for idx in faces:
#         face_clusters.Add(idx, path)
# ---------- end py3 ----------
file = ReadFile(File=path, PerLineParse=True)
csv = ReadCSV(CSVString=file, Delimiter=",")  # -> simplify(Headers), Values
demesh = DeconstructMesh(Mesh=py3.mesh_out)  # -> Vertices, Faces, Colours, Normals
faceb = FaceBoundaries(Mesh=py3.mesh_out)
rdpoints = RemoveDuplicatePointsKaramba3D(Point=demesh.Colours, LimitDistance=0.005)  # -> OutPoint, Info, Indexes
item = ListItem(List=faceb, Index=0, Wrap=True)
flip = FlipMatrix(Data=csv.Values)
bang = ExplodeTree(Data=item)  # -> Branch0, Branch1, Branch2, Branch3, Branch4
tstat = TreeStatistics(Tree=flip)  # -> Paths, Length, Count
merge = Merge(Data1=simplify(flatten(csv.Headers)), Data2=simplify(flatten(flip)))
item_2 = ListItem(List=tstat.Length, Index=0, Wrap=True)
partition = PartitionList(List=merge, Size=item_2)
null = NullItem(Item=partition)  # -> NullFlags, InvalidFlags, Description
py3_2 = Python3Script(x=partition)  # -> out, cleaned_tree; inputs x: tree
# ---------- py3_2: Python ----------
from Grasshopper import DataTree
from Grasshopper.Kernel.Data import GH_Path
import System

# Create new cleaned tree
cleaned_tree = DataTree[object]()  # Replace 'object' with your actual type like int, str, etc.

for i in range(x.BranchCount):
    path = x.Path(i)
    branch = x.Branch(i)  # This is a .NET list (System.Collections.Generic.List)

    # Optional: Convert to Python list for easier filtering
    py_branch = list(branch)

    # Filter and re-add
    filtered_items = [item for item in py_branch if item]  # `if item` removes falsy things like None, 0, "", etc.

    if filtered_items:
        for item in filtered_items:
            cleaned_tree.Add(item, path)
# ---------- end py3_2 ----------
tstat_2 = TreeStatistics(Tree=py3_2.cleaned_tree)  # -> Paths, Length, Count
item_3 = ListItem(List=tstat_2.Paths, Index=Slider(1, range=0..17), Wrap=True)
branch = TreeBranch(Tree=py3_2.cleaned_tree, Path=item_3, MaintainPaths=True)
faceb_2 = FaceBoundaries(Mesh=py3.mesh_out)
item_4 = ListItem(List=faceb_2, Index=branch, Wrap=True)
item_5 = ListItem(List=faceb_2, Index=py3_2.cleaned_tree, Wrap=True)
boundary = BoundarySurfaces(Edges=item_5)
area = Area(Geometry=boundary)  # -> Area, Centroid
smaller = SmallerThan(FirstNumber=area.Area, SecondNumber="0.001")  # -> SmallerThan, OrEqualTo
dispatch = Dispatch(List=boundary, DispatchPattern=smaller.SmallerThan)  # -> ListA, ListB
smesh = SimpleMesh(Brep=boundary)
cls = Closed()  # -> Closed, Periodic
wbjoin = WeaverbirdsJoinMeshesAndWeld(Mesh=smesh, Weld=invert(False))
mesh = Mesh(<mesh referenced from the Rhino model>)
triremesh = TriRemesh(Geometry=wbjoin, Iterations=25)  # -> Triangulation, Dual, Creases
mesh_2 = Mesh(wbjoin)
preview = CustomPreview(Material={diffuse=RGB(221, 160, 221), emission=RGB(66, 48, 66), shine=0.5, specular=RGB(255, 255, 255), transparency=0})
grphmsh = GraphFromMesh(InputMesh=mesh_2)
mstk = MSTKruskal(MeshGraph=py3.mesh_out, MaxSize=0, MaxValence=4, Sparse=False)
mstk_2 = MSTKruskal(MeshGraph=grphmsh, MaxSize=0, MaxValence=4, Sparse=False)
mesh_3 = Mesh(<mesh referenced from the Rhino model>)
triremesh_2 = TriRemesh(Geometry=mesh_3, Iterations=25)  # -> Triangulation, Dual, Creases
mguroll = MeshGraphUnroll(MeshGraph=mstk, StartFace=-1, UnrollPlane=PlaneXY(0, 0, 0))  # -> Mesh, SplitMeshgraphs, SplitFlatGraphs, UnrollEdgeSplits
mguroll_2 = MeshGraphUnroll(MeshGraph=mstk_2, StartFace=-1, UnrollPlane=PlaneXY(0, 0, 0))  # -> Mesh, SplitMeshgraphs, SplitFlatGraphs, UnrollEdgeSplits
lng = ListLength(List=flatten(mesh_2))
multiplication = Multiplication(A=lng, B=3)
mgurollviz = MeshGraphVisualUnroll(MeshGraph=mstk_2, StartFace=-1, Coefficient=Slider(0, range=0..1), RootDistance=0)  # -> Unfolded, RootPlane
random = Random(Range=Domain(0, 1), Number=multiplication, Seed=Slider(7, range=0..10))
mesh_4 = Mesh(mgurollviz.Unfolded)
multiplication_2 = Multiplication(A=random, B=255)
int = Integer(multiplication_2)
partition_2 = PartitionList(List=int, Size="3")
item_6 = ListItem(List=partition_2, Index=0, Wrap=True)  # -> Item, Item1, Item2
rgb = ColourRGB(Alpha=255, Red=item_6.Item, Green=item_6.Item1, Blue=item_6.Item2)
preview_2 = CustomPreview(Geometry=mesh_4, Material=rgb)
panel = Panel(rgb)
